# Grasshopper definition cellular_automata.gh (Grasshopper 1.0.7)
# plug-ins: Pufferfish, Anemone

rh_in_grid_spacing = Slider(15, range=0..30)
rh_in_grid_size = Slider(10, range=0..10)
md_slider = MDSlider(
    SliderMode=0,
    slider_value=Point(0.4952648151, 0.5518158703, 0.5),
    x_domain=Domain(0, 1),
    y_domain=Domain(0, 1),
    z_domain=Domain(0, 1))
md_slider_2 = MDSlider(
    SliderMode=0,
    slider_value=Point(0.5108456553, 0.3667349466, 0.5),
    x_domain=Domain(0, 1),
    y_domain=Domain(0, 1),
    z_domain=Domain(0, 1))
md_slider_3 = MDSlider(
    SliderMode=0,
    slider_value=Point(0.2429529806, 0.3163783376, 0.5),
    x_domain=Domain(0, 1),
    y_domain=Domain(0, 1),
    z_domain=Domain(0, 1))
series = Series(Start=0, Step=rh_in_grid_size, Count=rh_in_grid_spacing)
pt = ConstructPoint(XCoordinate=graft(series), YCoordinate=series, ZCoordinate=0)  # -> simplify(Point)
data = Data(flatten(pt))
brec = BoundingRectangle(Geometry=data, Plane=PlaneXY(0, 0, 0), Axis=0, Slide=0, Union=True)  # -> Bounding, DimensionX, DimensionY
evalsrf = EvaluateSurface(Surface=reparameterize(brec.Bounding), Point=md_slider_3)  # -> Point, Normal, UDirection, VDirection, Frame
evalsrf_2 = EvaluateSurface(Surface=reparameterize(brec.Bounding), Point=md_slider_2)  # -> Point, Normal, UDirection, VDirection, Frame
evalsrf_3 = EvaluateSurface(Surface=reparameterize(brec.Bounding), Point=md_slider)  # -> Point, Normal, UDirection, VDirection, Frame
rectangle = Rectangle(Plane=evalsrf.Point, XSize=Slider(10, range=0..10), YSize=Slider(44, range=0..100), Radius=0)  # -> Rectangle, Length
rectangle_2 = Rectangle(Plane=evalsrf_2.Point, XSize=Slider(32, range=0..100), YSize=Slider(26, range=0..30), Radius=0)  # -> Rectangle, Length
rectangle_3 = Rectangle(Plane=evalsrf_3.Point, XSize=Slider(10, range=0..10), YSize=Slider(60, range=0..100), Radius=0)  # -> Rectangle, Length
crv = Curve(rectangle.Rectangle)
crv_2 = Curve(rectangle_3.Rectangle)
crv_3 = Curve(rectangle_2.Rectangle)
incurves = PointInCurves(Point=pt, Curves=[crv_3, crv, crv_2])  # -> Relationship, Index, Point
division = Division(A=incurves.Relationship, B=2)
int = Integer(division)
tag = TextTag3D(Location=pt, Text=int, Size=Slider(5, range=0..10), Justification=7)
num = Number(int)
rh_in_step = Slider(0, range=0..50)
fastloopstart = FastLoopStart(I=rh_in_step, Grid=pt, _0_or_1=num)  # -> port, Counter, Data, _0Or1
num_2 = Number(simplify(fastloopstart._0Or1))
tstat = TreeStatistics(Tree=num_2)  # -> Paths, Length, Count
shift = ShiftList(List=tstat.Paths, Shift=1, Wrap=True)
shift_2 = ShiftList(List=tstat.Paths, Shift="-1", Wrap=True)
branch = TreeBranch(Tree=num_2, Path=shift, MaintainPaths=False)
branch_2 = TreeBranch(Tree=num_2, Path=shift_2, MaintainPaths=False)
num_3 = Number(graft(branch_2))
num_4 = Number(graft(branch))
shift_3 = ShiftList(List=num_2, Shift=1, Wrap=True)  # -> graft(List)
shift_4 = ShiftList(List=num_2, Shift="-1", Wrap=True)  # -> graft(List)
shift_5 = ShiftList(List=branch, Shift=1, Wrap=True)  # -> graft(List)
shift_6 = ShiftList(List=branch, Shift="-1", Wrap=True)  # -> graft(List)
shift_7 = ShiftList(List=branch_2, Shift="-1", Wrap=True)  # -> graft(List)
shift_8 = ShiftList(List=branch_2, Shift=1, Wrap=True)  # -> graft(List)
merge = Merge(
    Data1=simplify(shift_3),
    Data2=simplify(shift_4),
    Data3=simplify(shift_5),
    Data4=simplify(num_4),
    Data5=simplify(shift_6),
    Data6=simplify(shift_8),
    Data7=simplify(num_3),
    Data8=simplify(shift_7))
data_2 = Data(fastloopstart.Data)
num_5 = Number(num_2)
viewer = ParamViewer(merge)
ma = MassAddition(Input=merge)  # -> Result, PartialResults
trim = TrimTree(Tree=ma.Result, Depth=1)

# ---- group: Life
smaller = SmallerThan(FirstNumber=trim, SecondNumber=Slider(3, range=0..10))  # -> SmallerThan, OrEqualTo
larger = LargerThan(FirstNumber=trim, SecondNumber=Slider(3, range=0..10))  # -> LargerThan, OrEqualTo
and = GateAnd(A=larger.OrEqualTo, B=smaller.OrEqualTo)

# ---- group: Death
smaller_2 = SmallerThan(FirstNumber=trim, SecondNumber=Slider(2, range=0..10))  # -> SmallerThan, OrEqualTo
larger_2 = LargerThan(FirstNumber=trim, SecondNumber=Slider(3, range=0..10))  # -> LargerThan, OrEqualTo
or = GateOr(A=smaller_2.SmallerThan, B=larger_2.LargerThan)

# ----
cull = CullPattern(List=pt, CullPattern=or)  # disabled
num_6 = Number(rh_in_step)
lng = ListLength(List=num_5)
repeat = RepeatData(Data=Slider(0, range=0..100), Length=lng)
lng_2 = ListLength(List=num_5)
p_n_c = PickNChoose(Pattern=or, Stream0=num_5, Stream1=repeat)
repeat_2 = RepeatData(Data=Slider(1, range=0..100), Length=lng_2)
p_n_c_2 = PickNChoose(Pattern=and, Stream0=p_n_c, Stream1=repeat_2)
cull_2 = CullPattern(List=data_2, CullPattern=p_n_c_2)
panel = Panel(p_n_c_2)
pt_2 = Point()
multiplication = Multiplication(A=num_6, B=Slider(2, range=0..10))
fastloopend = FastLoopEnd(port=fastloopstart.port, Exit=False, Data=fastloopstart.Data, _0Or1=p_n_c_2, RecordData=False, TimeOutVal=0)  # -> D0, D1
Z = UnitZ(Factor=multiplication)
cull_3 = CullPattern(List=fastloopend.D0, CullPattern=fastloopend.D1)
move = Move(Geometry=cull_3, Motion=Z)  # -> Geometry, Transform
num_7 = Number(num_5)
multiplication_2 = Multiplication(A=rh_in_grid_size, B="0.5")
msphere = MeshSphere(Base=move.Geometry, Radius=multiplication_2, UCount=10, VCount=20)  # -> flatten(Mesh)
clean = CleanTree(RemoveNulls=True, RemoveInvalid=True, RemoveEmpty=False, Tree=msphere)
mjoin = MeshJoin(Meshes=clean)
preview = CustomPreview(Geometry=mjoin, Material=ColourSwatch(SwatchColor=RGB(176, 0, 0)))
rh_out_mesh = Mesh(mjoin)
